# Grasshopper definition HopTo_A_02_FormatString.gh (Grasshopper 1.0.7)
# plug-ins: Bifocals, Hops

# Hopped To Hops for Grasshopper
number_slider = Slider(0, range=0..100)
hops = Hops(
    DoubleX=number_slider,
    DoubleY=Slider(0, range=0..100),
    CacheResultsInMemory=True,
    CacheSolveResults=True,
    RemoteDefinitionLocation="C:\Users\Sculpture\Desktop\HoppedUpandTo_C#Scripts\HoppedUp\HoppedUp_A_02_FormatString.gh",
    RemoteSolveVersion=(0, 1, 0),
    ShowInput_Enabled=False,
    ShowInput_Path=False,
    SynchronousSolve=True)  # -> A_02_FormatStringOut, A_02_FormatStringA
panel = Panel(hops.A_02_FormatStringOut)
