# Grasshopper definition HopTo_A_03_CultureInfoFormat.gh (Grasshopper 1.0.7)
# plug-ins: Hops

hops = Hops(
    DoubleX=Slider(0.25, range=0..1),
    DoubleY=Slider(0.25, range=0..1),
    CacheResultsInMemory=True,
    CacheSolveResults=True,
    RemoteDefinitionLocation="C:\Users\Sculpture\Desktop\HoppedUpandTo_C#Scripts\HoppedUp\HoppedUp_A_03_CultureInfoFormat.gh",
    RemoteSolveVersion=(0, 1, 0),
    ShowInput_Enabled=False,
    ShowInput_Path=False,
    SynchronousSolve=True)  # -> A_03_CultureInfoFormatOut, A_03_CultureInfoFormatA
panel = Panel(hops.A_03_CultureInfoFormatOut)
