# Grasshopper definition HopTo_A_04_FormatListAndOutput.gh (Grasshopper 1.0.7)
# plug-ins: Hops

listofnums = GetNumber(
    [Slider(0, range=0..10), Slider(1.84, range=0..10)],
    AtLeast=1,
    AtMost=1,
    Maximum=1.797693135e+308,
    Minimum=-1.797693135e+308)
hops = Hops(
    ListOfNums=listofnums,
    CacheResultsInMemory=True,
    CacheSolveResults=True,
    RemoteDefinitionLocation="C:\Users\Sculpture\Desktop\HoppedUpandTo_C#Scripts\HoppedUp\HoppedUp_A_04_FormatListAndOutput.gh",
    RemoteSolveVersion=(0, 1, 0),
    ShowInput_Enabled=False,
    ShowInput_Path=False,
    SynchronousSolve=True)  # -> A_04_FormatListAndOutputOut, A_04_FormatListAndOutputFormattedText
panel = Panel(hops.A_04_FormatListAndOutputFormattedText)
