# Grasshopper definition HopTo_B_01_InputOutputData (2).gh (Grasshopper 1.0.7)
# plug-ins: Hops

hops = Hops(
    Int=Slider(3, range=0..10),
    Double=Slider(34.99, range=0..100),
    Bool=Toggle(True),
    CacheResultsInMemory=True,
    CacheSolveResults=True,
    RemoteDefinitionLocation="C:\Users\Sculpture\Desktop\HoppedUpandTo_C#Scripts\HoppedUp\HoppedUp_B_01_InputOutputData.gh",
    RemoteSolveVersion=(0, 1, 0),
    ShowInput_Enabled=False,
    ShowInput_Path=False,
    SynchronousSolve=True)  # -> Int, Double, Bool
panel = Panel([hops.Int, hops.Double, hops.Bool])
