# Grasshopper definition HopTo_B_05_OtherTypes.gh (Grasshopper 1.0.7)
# plug-ins: Hops

create_complex = CreateComplex(Real=Slider(2.36, range=0..10), Imaginary=Slider(5.02, range=0..10))
hops = Hops(
    Complex_num=create_complex,
    Colors=ColourSwatch(SwatchColor=RGB(26, 112, 255)),
    CacheResultsInMemory=True,
    CacheSolveResults=True,
    RemoteDefinitionLocation="C:\Users\Sculpture\Desktop\HoppedUpandTo_C#Scripts\HoppedUp\HoppedUp_B_05_OtherTypes.gh",
    RemoteSolveVersion=(0, 1, 0),
    ShowInput_Enabled=False,
    ShowInput_Path=False,
    SynchronousSolve=True)
b_05_othertypes = B_05_OtherTypes()  # -> out, A; inputs someColour: Color, globalUniqueIdentifier: Guid; disabled
# ---------- b_05_othertypes: C# ----------
    //Complex is a structure from Grasshopper.Kernel.Types namespace;
    //DateTime is a structure from System namespace
    //Color is a structure from System.Drawing namespace
    //Guid is a structure from System namespace

    //all of these types are structures, so they are value types

    Print("complexNum is real: {0}", complexNum.IsReal);
    Print(dateAndTime.DayOfWeek.ToString());
    Print("Colour R: {0}, G: {1}, B: {2}", someColour.R, someColour.G, someColour.B);
    Print("Identifier: {0}", globalUniqueIdentifier.ToString());
# ---------- end b_05_othertypes ----------
panel = Panel(hops)
