# Grasshopper definition HopTo_C_01_Point3DStructure.gh (Grasshopper 1.0.7)
# plug-ins: Hops

number_slider = Slider(5.21, range=0..10)
hops = Hops(
    NumX=number_slider,
    NumY=number_slider,
    NumZ=number_slider,
    CacheResultsInMemory=True,
    CacheSolveResults=True,
    RemoteDefinitionLocation="C:\Users\Sculpture\Desktop\HoppedUpandTo_C#Scripts\HoppedUp\HoppedUp_C_01_Point3DStructure.gh",
    RemoteSolveVersion=(0, 1, 0),
    ShowInput_Enabled=False,
    ShowInput_Path=False,
    SynchronousSolve=True)  # -> Pt, Out
panel = Panel(hops.Out)
point = Point(hops.Pt)
