# Grasshopper definition HopTo_C_02_ReferenceAndValueTypes.gh (Grasshopper 1.0.7)
# plug-ins: Hops

range = Range(Domain=Domain(0, 1), Steps=10)
construct_point = ConstructPoint(XCoordinate=0, YCoordinate=0, ZCoordinate=0)
construct_point_2 = ConstructPoint(XCoordinate=range, YCoordinate=range, ZCoordinate=0)
polyline = PolyLine(Vertices=construct_point_2, Closed=False)
hops = Hops(
    Point=construct_point,
    Polyline=polyline,
    CacheResultsInMemory=True,
    CacheSolveResults=True,
    RemoteDefinitionLocation="C:\Users\Sculpture\Desktop\HoppedUpandTo_C#Scripts\HoppedUp\HoppedUp_C_02_ReferenceAndValueTypes.gh",
    RemoteSolveVersion=(0, 1, 0),
    ShowInput_Enabled=False,
    ShowInput_Path=False,
    SynchronousSolve=True)  # -> Value_pt, Value_polyline, Ref_pt, Ref_polyline
point = Point(hops.Ref_pt)
point_2 = Point(hops.Value_pt)
curve = Curve(hops.Value_polyline)
curve_2 = Curve(hops.Ref_polyline)
