# Grasshopper definition HopTo_DT_SeriesAndRangeNode.gh (Grasshopper 1.0.7)
# plug-ins: Hops

hops = Hops(
    IntX=Slider(0, range=0..10),
    IntY=Slider(2, range=0..10),
    IntZ=Slider(10, range=0..10),
    CacheResultsInMemory=True,
    CacheSolveResults=True,
    RemoteDefinitionLocation="C:\Users\Sculpture\Desktop\HoppedUpandTo_C#Scripts\HoppedUp\HoppedUp_DT_SeriesAndRangeNode.gh",
    RemoteSolveVersion=(0, 1, 0),
    ShowInput_Enabled=False,
    ShowInput_Path=False,
    SynchronousSolve=True)  # -> My_series, My_range
panel = Panel(hops.My_series)
panel_2 = Panel(hops.My_range)
