# Grasshopper definition HopTo_D_01_BasicOperators.gh (Grasshopper 1.0.7)
# plug-ins: Hops

hops = Hops(
    Num1=Slider(2, range=0..10),
    Num2=Slider(4.48, range=0..10),
    CacheResultsInMemory=True,
    CacheSolveResults=True,
    RemoteDefinitionLocation="C:\Users\Sculpture\Desktop\HoppedUpandTo_C#Scripts\HoppedUp\HoppedUp_D_01_BasicOperators.gh",
    RemoteSolveVersion=(0, 1, 0),
    ShowInput_Enabled=False,
    ShowInput_Path=False,
    SynchronousSolve=True)  # -> Additon, Difference, Multiplication, Division
panel = Panel([hops.Additon, hops.Difference, hops.Multiplication, hops.Division])
