# Grasshopper definition HopTo_D_03_DoubleconversionMathround.gh (Grasshopper 1.0.7)
# plug-ins: Hops

hops = Hops(
    Int=Slider(10, range=0..10),
    Double=Slider(0, range=0..10),
    CacheResultsInMemory=True,
    CacheSolveResults=True,
    RemoteDefinitionLocation="C:\Users\Sculpture\Desktop\HoppedUpandTo_C#Scripts\HoppedUp\HoppedUp_D_03_DoubleconversionMathround.gh",
    RemoteSolveVersion=(0, 1, 0),
    ShowInput_Enabled=False,
    ShowInput_Path=False,
    SynchronousSolve=True)  # -> ConvertedInt, ConvertedDouble
panel = Panel([hops.ConvertedInt, hops.ConvertedDouble])
