# Grasshopper definition HopTo_D_03_IntegerDivision.gh (Grasshopper 1.0.7)
# plug-ins: Hops

hops = Hops(
    Num1=Slider(5.76, range=0..10),
    Num2=Slider(2.72, range=0..10),
    CacheResultsInMemory=True,
    CacheSolveResults=True,
    RemoteDefinitionLocation="C:\Users\Sculpture\Desktop\HoppedUpandTo_C#Scripts\HoppedUp\HoppedUp_D_03_IntegerDivision.gh",
    RemoteSolveVersion=(0, 1, 0),
    ShowInput_Enabled=False,
    ShowInput_Path=False,
    SynchronousSolve=True)
panel = Panel(hops)
