# Grasshopper definition HopTo_D_05_IntegerModuloDivision.gh (Grasshopper 1.0.7)
# plug-ins: Hops

hops = Hops(
    Num1=Slider(12, range=0..100),
    Num2=Slider(3, range=0..10),
    CacheResultsInMemory=True,
    CacheSolveResults=True,
    RemoteDefinitionLocation="C:\Users\Sculpture\Desktop\HoppedUpandTo_C#Scripts\HoppedUp\HoppedUp_D_05_IntegerModuloDivision.gh",
    RemoteSolveVersion=(0, 1, 0),
    ShowInput_Enabled=False,
    ShowInput_Path=False,
    SynchronousSolve=True)  # -> Int_division, Remainder
panel = Panel([hops.Int_division, hops.Remainder])
