# Grasshopper definition HopTo_D_07_IncrementDecrement.gh (Grasshopper 1.0.7)
# plug-ins: Hops

hops = Hops(
    NumX=Slider(12, range=0..100),
    NumY=Slider(2, range=0..10),
    NumZ=Slider(5, range=0..10),
    CacheResultsInMemory=True,
    CacheSolveResults=True,
    RemoteDefinitionLocation="C:\Users\Sculpture\Desktop\HoppedUpandTo_C#Scripts\HoppedUp\HoppedUp_D_07_IncrementDecrement.gh",
    RemoteSolveVersion=(0, 1, 0),
    ShowInput_Enabled=False,
    ShowInput_Path=False,
    SynchronousSolve=True)  # -> IncrementY, IncrementZ
panel = Panel([hops.IncrementY, hops.IncrementZ])
