# Grasshopper definition HopTo_D_09_ToggleSwitchAB.gh (Grasshopper 1.0.7)
# plug-ins: Hops

panel = Panel()
text_case = TextCase(Text=panel, Culture=127)  # -> UpperCase, LowerCase
hops = Hops(
    Val_stringA=text_case.UpperCase,
    Val_stringB=text_case.LowerCase,
    Toggle=Toggle(False),
    CacheResultsInMemory=True,
    CacheSolveResults=True,
    RemoteDefinitionLocation="C:\Users\Sculpture\Desktop\HoppedUpandTo_C#Scripts\HoppedUp\HoppedUp_D_09_ToggleSwitchAB.gh",
    RemoteSolveVersion=(0, 1, 0),
    ShowInput_Enabled=False,
    ShowInput_Path=False,
    SynchronousSolve=True)
panel_2 = Panel(hops)
