# Grasshopper definition HopTo_D_10_Precedence.gh (Grasshopper 1.0.7)
# plug-ins: Hops

hops = Hops(
    NumX=Slider(17.896, range=0..100),
    NumY=Slider(43.444, range=0..100),
    NumZ=Slider(72.922, range=0..100),
    CacheResultsInMemory=True,
    CacheSolveResults=True,
    RemoteDefinitionLocation="C:\Users\Sculpture\Desktop\HoppedUpandTo_C#Scripts\HoppedUp\HoppedUp_D_10_Precedence.gh",
    RemoteSolveVersion=(0, 1, 0),
    ShowInput_Enabled=False,
    ShowInput_Path=False,
    SynchronousSolve=True)
panel = Panel(hops)
