# Grasshopper definition HopTo_D_D_06_EqualityVSAssignment.gh (Grasshopper 1.0.7)
# plug-ins: Hops

hops = Hops(
    NumX=Slider(2, range=0..10),
    NumY=Slider(5, range=0..10),
    CacheResultsInMemory=True,
    CacheSolveResults=True,
    RemoteDefinitionLocation="C:\Users\Sculpture\Desktop\HoppedUpandTo_C#Scripts\HoppedUp\HoppedUp_D_06_EqualityVSAssignment.gh",
    RemoteSolveVersion=(0, 1, 0),
    ShowInput_Enabled=False,
    ShowInput_Path=False,
    SynchronousSolve=True)
panel = Panel(hops)
