# Grasshopper definition HopTo_E_01_IfStatement.gh (Grasshopper 1.0.7)
# plug-ins: Hops

hops = Hops(
    NumX=Slider(2.67, range=0..10),
    NumY=Slider(7.01, range=0..10),
    CacheResultsInMemory=True,
    CacheSolveResults=True,
    RemoteDefinitionLocation="C:\Users\Sculpture\Desktop\HoppedUpandTo_C#Scripts\HoppedUp\HoppedUp_E_01_IfStatement.gh",
    RemoteSolveVersion=(0, 1, 0),
    ShowInput_Enabled=False,
    ShowInput_Path=False,
    SynchronousSolve=True)
panel = Panel(hops)
