# Grasshopper definition HopTo_O_01_ExceptionsAndRuntimeMessages.gh (Grasshopper 1.0.7)
# plug-ins: Hops

hops = Hops(
    NumX=Slider(1, range=0..1),
    NumY=Slider(4.96, range=0..10),
    CacheResultsInMemory=True,
    CacheSolveResults=True,
    RemoteDefinitionLocation="C:\Users\Sculpture\Desktop\HoppedUpandTo_C#Scripts\HoppedUp\HoppedUp_O_01_ExceptionsAndRuntimeMessages.gh",
    RemoteSolveVersion=(0, 1, 0),
    ShowInput_Enabled=False,
    ShowInput_Path=False,
    SynchronousSolve=True)  # -> O_01_ExceptionsAndRuntimeMessagesOut, O_01_ExceptionsAndRuntimeMessagesA
panel = Panel([hops.O_01_ExceptionsAndRuntimeMessagesOut, hops.O_01_ExceptionsAndRuntimeMessagesA])
