# Grasshopper definition HopTo_Trusses_Espinales_2021.gh (Grasshopper 1.0.7)
# plug-ins: Hops

point = Point(<point referenced from the Rhino model>)
point_2 = Point(<point referenced from the Rhino model>)
hops = Hops(
    FirstPoint=point,
    SecondPoint=point_2,
    Height=Slider(4.32, range=0..10),
    Depth=Slider(5, range=0..10),
    Width=Slider(2, range=0..10),
    Spans=Slider(9, range=0..100),
    Void=Slider(7, range=0..100),
    RadiiPipe=Slider(1, range=0..10),
    RadiiSpanPipe=Slider(1, range=0..10),
    GetNumber=Slider(0.22, range=0..1),
    CacheResultsInMemory=True,
    CacheSolveResults=True,
    RemoteDefinitionLocation="C:\Users\Sculpture\Desktop\HopperUp_Trusses_Espinales_2021.gh",
    RemoteSolveVersion=(0, 1, 0),
    ShowInput_Enabled=False,
    ShowInput_Path=False,
    SynchronousSolve=True)  # -> Pipe, SpanPipes, FinalGeo1, FinalGeo2, FinalGeo3
