# Grasshopper definition HoppedUp_F_05_RiskyLoopVariation.gh (Grasshopper 1.0.7)

integers = GetInteger(Slider(12, range=0..100), AtLeast=1, AtMost=1, Maximum=2147483647, Minimum=-2147483648)
f_05_riskyloopvariation = F_05_RiskyLoopVariation(iterations=integers)  # -> out; inputs iterations: Int32
# ---------- f_05_riskyloopvariation: C# ----------
    Component.Message = "for() loop variations";

    int i = 0;
    for(; ;)  //risky infinite loop
    {
      if(i >= iterations)
        break;
      if(i++ % 2 != 0)
        continue;
      Print(i.ToString());
    }
# ---------- end f_05_riskyloopvariation ----------

# ---- group: RH_OUT:odd_loops
integer = Integer(f_05_riskyloopvariation)

# ----
panel = Panel(integer)
