# Grasshopper definition HoppedUp_K_03_CreateEmptyArrayPolyline.gh (Grasshopper 1.0.7)

count = GetInteger(Slider(5, range=0..10), AtLeast=1, AtMost=1, Maximum=2147483647, Minimum=-2147483648)
k_03_createemptyarraypolyline = K_03_CreateEmptyArrayPolyline(count=count)  # -> out, myArray; inputs count: Int32
# ---------- k_03_createemptyarraypolyline: C# ----------
    if(default(Polyline) == null)
      Print("Polyline defualt value: <null>");

    Polyline[] pLineArray = new Polyline[count];    //creates an array of <count> elements and initializes them with default values
    myArray = pLineArray;
# ---------- end k_03_createemptyarraypolyline ----------

# ---- group: RH_OUT:polyline_default
text = Text(k_03_createemptyarraypolyline.out)

# ---- group: RH_OUT:empty_array_polyline
geometry = Geometry(k_03_createemptyarraypolyline.myArray)

# ----
panel = Panel(geometry)
panel_2 = Panel(text)
