# Grasshopper definition HoppedUp_K_CreateArray3DPoints.gh (Grasshopper 1.0.7)

count = GetInteger(Slider(7, range=0..100), AtLeast=1, AtMost=1, Maximum=2147483647, Minimum=-2147483648)
k_createarray3dpoints = K_CreateArray3DPoints(count=count)  # -> out, myArray; inputs count: Int32
# ---------- k_createarray3dpoints: C# usings ----------
using System.IO;
using System.Linq;
using System.Data;
using System.Drawing;
using System.Reflection;
using System.Windows.Forms;
using System.Xml;
using System.Xml.Linq;
using System.Runtime.InteropServices;

using Rhino.DocObjects;
using Rhino.Collections;
using GH_IO;
using GH_IO.Serialization;
# ---------- k_createarray3dpoints: C# ----------
    Print("Point3d default value: {0}", default(Point3d));

    Point3d[] ptArray = new Point3d[count];    //creates an array of <count> elements and initializes them with default values
    myArray = ptArray;
# ---------- end k_createarray3dpoints ----------

# ---- group: RH_OUT:out
text = Text(k_createarray3dpoints.out)

# ---- group: RH_OUT:myPointArray
point = Point(k_createarray3dpoints.myArray)

# ----
panel = Panel(point)
panel_2 = Panel(text)
