# Grasshopper definition HoppedUp_K_FillingArray.gh (Grasshopper 1.0.7)

panel = Panel()
default = GetString(panel, AtLeast=1, AtMost=1)
k_fillingarray = K_FillingArray(default=default)  # -> out, array1, array2; inputs default: String
# ---------- k_fillingarray: C# ----------
    int[] intArray = new int[4];
    intArray[0] = 1;
    intArray[1] = 3;
    intArray[2] = 3;
    intArray[3] = 7;

    int[] intArray2 = {3, 4, 6, 1, 10};

    array1 = intArray;
    array2 = intArray2;
# ---------- end k_fillingarray ----------

# ---- group: RH_OUT:array1
number = Number(k_fillingarray.array1)

# ---- group: RH_OUT:array2
number_2 = Number(k_fillingarray.array2)

# ----
panel_2 = Panel(number)
panel_3 = Panel(number_2)
