# Grasshopper definition HoppedUp_O_01_ExceptionsAndRuntimeMessages.gh (Grasshopper 1.0.7)

numy = GetNumber(Slider(1, range=0..1), AtLeast=1, AtMost=1, Maximum=1.797693135e+308, Minimum=-1.797693135e+308)
numx = GetNumber(Slider(1, range=0..1), AtLeast=1, AtMost=1, Maximum=1.797693135e+308, Minimum=-1.797693135e+308)
o_01_exceptionsandruntimemessages = O_01_ExceptionsAndRuntimeMessages(x=numx, y=numy)  # -> out, A; inputs x: Double, y: Double
# ---------- o_01_exceptionsandruntimemessages: C# usings ----------
using System.IO;
using System.Linq;
using System.Data;
using System.Drawing;
using System.Reflection;
using System.Windows.Forms;
using System.Xml;
using System.Xml.Linq;
using System.Runtime.InteropServices;

using Rhino.DocObjects;
using Rhino.Collections;
using GH_IO;
using GH_IO.Serialization;
# ---------- o_01_exceptionsandruntimemessages: C# ----------
    Component.Message = "Runtime messages";
    if(x != 0)
      Component.AddRuntimeMessage(GH_RuntimeMessageLevel.Remark, "This is a remark.");
    //Component.AddRuntimeMessage(GH_RuntimeMessageLevel.Warning, "This is a warning.");
    //Component.AddRuntimeMessage(GH_RuntimeMessageLevel.Error, "This is an error!");
    if(x == 0)
      throw new Exception("This is an Wickreson exception");  //prevents from giving any result
    //although you shouldn't throw generic "Exception". Look for more precise reasons

    A = x * y;
# ---------- end o_01_exceptionsandruntimemessages ----------

# ---- group: RH_OUT:exception
text = Text(o_01_exceptionsandruntimemessages.out)

# ---- group: RH_OUT:number
number = Number(o_01_exceptionsandruntimemessages.A)

# ----
panel = Panel([text, number])
